# Grasshopper definition annual_daylight.gh (Grasshopper 1.0.7)

# ---- group: Opaque Faces
geo = Geometry([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])
roomsolid = HBRoomFromSolid(geo=flatten(geo), name="TestRoom", conditioned=True)  # -> report, rooms; plug-in component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

# ---- group: Apertures
# Geometry Preparation
panel = Panel("g_material")
glassmod = HBGlassModifier(name=panel, trans="0.55")  # -> modifier; plug-in component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
brep = Brep([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])
aperture = HBAperture(geo=brep, rad_mod=glassmod)  # -> report, apertures; plug-in component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
addsubface = HBAddSubface(hb_obj=roomsolid.rooms, sub_faces=flatten(aperture.apertures))  # -> hb_obj; plug-in component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
bordershades = HBExtrudedBorderShades(hb_objs=flatten(addsubface), depth="0.3")  # -> report, hb_objs; plug-in component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

# ---- group: Context!
brep_2 = Brep([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])
shade = HBShade(geo=brep_2)  # -> report, shades; plug-in component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

# ----
# Wea
panel_2 = Panel("https://www.energyplus.net/weather-download/north_and_central_america_wmo_region_4/USA/MA/USA_MA_Boston-Logan.Intl.AP.725090_TMY3/all")
downloadepw = LBDownloadWeather(weather_URL=panel_2)  # -> epw_file, stat_file, ddy_file; plug-in component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
wea = HBWeaFromEPW(epw_file=downloadepw.epw_file)  # -> wea; plug-in component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

# ----
# Model
# + Grids
panel_3 = Panel("sample_model_grid")
model = HBModel(rooms=flatten(bordershades.hb_objs), shades=flatten(shade.shades), name=panel_3)  # -> report, model; plug-in component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
gridrooms = HBSensorGridFromRooms(rooms=bordershades.hb_objs, grid_size="1")  # -> grid, points, mesh; plug-in component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
assigngridsviews = HBAssignGridsAndViews(model=model.model, grids=flatten(gridrooms.grid))  # -> model; plug-in component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

# ----
# Run Recipe
panel_4 = Panel("30")
annualdaylight = HBAnnualDaylight(model=assigngridsviews, wea=wea, north=0, sensor_count=panel_4, radiance_parameters=" ")  # -> workflow; plug-in component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
runworkflow = HBRunWorkflow(workflow=annualdaylight, cpu_count="10", run=Toggle(False))  # -> report, results; plug-in component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

# ----
# Parse
# Results
panel_5 = Panel("500")
annualmetrics = HBAnnualDaylightMetrics(results=runworkflow.results, threshold=panel_5)  # -> report, DA, UDI; plug-in component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
panel_6 = Panel(annualmetrics.DA)

# ----
# Visualize
# Results
vizwiref = HBVizualizeWireframe(hb_objs=flatten(model.model))  # -> geo; plug-in component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
mjoin = MeshJoin(Meshes=gridrooms.mesh)
heatmap = LBSpatialHeatmap(values=flatten(annualmetrics.DA), mesh=mjoin, legend_title="%", global_title="Daylight Autonomy")  # -> mesh, legend, title, colors, legend_par; plug-in component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
