# Grasshopper definition creating_skies.gh (Grasshopper 1.0.7)

txt = Text("https://www.energyplus.net/weather-download/north_and_central_america_wmo_region_4/USA/IL/USA_IL_Chicago-OHare.725300_TMY2/all")
downloadepw = LBDownloadWeather(weather_URL=txt)  # -> epw_file, stat_file, ddy_file; plug-in component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
importloc = LBImportLocation(epw_file=downloadepw.epw_file)  # -> location; plug-in component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
clearsky = HBClearSky(location=importloc)  # -> wea; plug-in component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
tauclearsky = HBTauClearSkyFromSTAT(stat_file=downloadepw.stat_file, timestep="1")  # -> wea; plug-in component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
wea = HBWeaFromEPW(epw_file=downloadepw.epw_file)  # -> wea; plug-in component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
certainillum = HBCertainIlluminance()  # -> sky; plug-in component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
ciesky = HBCIEStandardSky(location=importloc, month=6, day=21, type=0)  # -> sky; plug-in component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
customsky = HBCustomSky(location=importloc, dir_rad="800", diff_rad="100", month=6, day=21, hour=12)  # -> sky; plug-in component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
climatebased = HBClimatebasedSky(wea=wea, month="9", hour="9")  # -> sky; plug-in component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
